% Requirement links of ReqsGroundTruth.slx (R2021b)

block :178 implements Demo_video.mldatx: Test Case SS in Demo_video
block :178 implements Demo_video.mldatx: Test Case TL in Demo_video
block :178 implements Demo_test_req.slreqx#1
block :178 implements Demo_test_req.slreqx#2